# Grasshopper definition 哈尔滨大剧院玻璃.gh (Grasshopper 1.0.7)
# plug-ins: LunchBox

brep = Brep(<brep referenced from the Rhino model>)
crv = Curve(<curve referenced from the Rhino model>)
crv_2 = Curve(<curve referenced from the Rhino model>)
divide = DivideCurve(Curve=crv_2, Count=Slider(32, range=0..100), Kinks=False)  # -> Points, Tangents, Parameters
divide_2 = DivideCurve(Curve=crv, Count=Slider(30, range=0..100), Kinks=False)  # -> Points, Tangents, Parameters
diamond = DiamondPanels(Surface=brep, UDivisions=Slider(32, range=0..100), VDivisions=Slider(12, range=0..100))  # -> DiamondPanels, TriPanels
subsrf = Isotrim(Surface=brep)
ln = Line(StartPoint=divide_2.Points, EndPoint=divide.Points)
area = Area(Geometry=subsrf)  # -> Area, Centroid
area_2 = Area(Geometry=diamond.DiamondPanels)  # -> Area, Centroid
swp2 = Sweep2(Rail1=crv, Rail2=crv_2, Sections=ln, SameHeight=False)
srf_cp = SurfaceClosestPoint(Point=area_2.Centroid, Surface=brep)  # -> Point, UVPoint, Distance
evalsrf = EvaluateSurface(Surface=brep, Point=srf_cp.UVPoint)  # -> Point, Normal, UDirection, VDirection, Frame
neg = Negative(Value=Slider(14, range=0..100))
amp = Amplitude(Vector=evalsrf.Normal, Amplitude=neg)
move = Move(Geometry=evalsrf.Point, Motion=amp)  # -> Geometry, Transform
extr = ExtrudePoint(Base=diamond.DiamondPanels, Point=move.Geometry)
preview = CustomPreview(
    Geometry=extr,
    Material={diffuse=RGB(221, 160, 221), emission=RGB(66, 48, 66), shine=0.5, specular=RGB(255, 255, 255), transparency=0})
